# Grasshopper definition 20240627_GH Connection Link.gh (Grasshopper 1.0.8)
# plug-ins: DrawingEvalCheck

file_path = FilePath("C:\Sakshi\Work\Freelance collaborations\Upwork\LocAI\20240619_Autocad testing_edited roof plan.dwg")
file_path_2 = FilePath("C:\Users\arsak\Desktop\")
bool = Boolean(True)
dwgfilepath = GetFilePath(file_path, AtLeast=1, AtMost=1, TreeAccess=False)
savedirpath = GetFilePath(file_path_2, AtLeast=1, AtMost=1, TreeAccess=False)
checkcompliance = GetBoolean(bool, AtLeast=1, AtMost=1, FalseValue="False", TreeAccess=False, TrueValue="True")
drawingeval = DrawingEval(FilePath=dwgfilepath, DirForExportFiles=savedirpath, Validate=checkcompliance)

# ---- group: RH_OUT
text = Text(drawingeval)
