# Grasshopper definition 20240802_GH Connection Link.gh (Grasshopper 1.0.8)
# plug-ins: DrawingEvalCheck

panel = Panel("https://sinan-public-test.s3.amazonaws.com/20240708_Test_Variation1+(1).dwg")
path = FilePath("C:\Users\arsak\Desktop\")
bool = Boolean(True)
checkcompliance = GetBoolean(bool, AtLeast=1, AtMost=1, FalseValue="False", TreeAccess=False, TrueValue="True")
dwgurl = GetString(panel, AtLeast=1, AtMost=1, TreeAccess=False)
savedirpath = GetString(path, AtLeast=1, AtMost=1, TreeAccess=False)
dwgeval = DrawingEval(FileURL=dwgurl, DirForExportFiles=savedirpath, Validate=checkcompliance)

# ---- group: RH_OUT
txt = Text(dwgeval)
