# Grasshopper definition 20240809_GH Connection Link.gh (Grasshopper 1.0.8)
# plug-ins: DrawingEvalCheck

panel = Panel("https://github.com/arbazpirwani/React-Clean-MVVM-Architecture/raw/main/abc.dwg")
path = FilePath("C:\Users\Administrator\Downloads\")
bool = Boolean(True)
checkcompliance = GetBoolean(bool, AtLeast=1, AtMost=1, FalseValue="False", TreeAccess=False, TrueValue="True")
dwgurl = GetString(panel, AtLeast=1, AtMost=1, TreeAccess=False)
savedirpath = GetString(path, AtLeast=1, AtMost=1, TreeAccess=False)
dwgeval = DrawingEval(FileURL=dwgurl, DirForExportFiles=savedirpath, Validate=checkcompliance)
dwgeval_2 = DrawingEval(FileURL=dwgurl, DirForExportFiles=savedirpath, Validate=checkcompliance)  # disabled

# ---- group: RH_OUT
txt = Text(dwgeval)
