# Grasshopper definition GenerativeFloorPlanTest.gh (Grasshopper 1.0.8)
# plug-ins: jSwan, marmot, Human, Kangaroo2 Components, Pancake

# Default Values
inputjson = Panel("""{
  "Setback": {
    "Front": 3,
    "Rear": 2,
    "Side": 1
  },
  "RoomNames": [
    "Living",
    "Bedroom",
    "WC",
    "Kitchen",
    "Lobby",
    "Majlis",
    "Pool"
  ],
  "RoomTopology": [
    "Living-Kitchen",
    "Bedroom-WC",
    "WC-Kitchen",
    "Lobby-Majlis",
    "Pool-Living"
  ],
  "PlotWidth": 15,
  "PlotDepth": 18,
  "FAR": 0.5,
  "RoomAreas": [
    45,
    25,
    10,
    20,
    5,
    25,
    15
  ],
  "ExportLocation": "C:\\Users\\LocAI\\source\\repos\\rhino-developer-samples\\compute\\cs\\SampleGHSolve\\bin\\Debug\\files\\"
}""")
jsoninput = GetString(inputjson, AtLeast=1, AtMost=1, TreeAccess=False)
# Rhino.Compute Inputs
panel = Panel(jsoninput)
setbackside = Slider(1, range=0..10)
plotwidth = Slider(20, range=10..100)
plotdepth = Slider(16, range=10..100)
far = Slider(0.5, range=0..1)
setbackfront = Slider(3, range=0..10)
setbackrear = Slider(2, range=0..10)
deserialize_json = DeserializeJson(JSON=jsoninput, OutputsLocked=False)  # -> Setback, RoomNames, RoomTopology, PlotWidth, PlotDepth, FAR, RoomAreas, ExportLocation
deserialize_json_2 = DeserializeJson(JSON=deserialize_json.Setback, OutputsLocked=False)  # -> Front, Rear, Side

plotwidth_2 = GetNumber(plotwidth, AtLeast=1, AtMost=1, Maximum=1.797693135e+308, Minimum=-1.797693135e+308, TreeAccess=False)  # disabled
setbackfront_2 = GetNumber(setbackfront, AtLeast=1, AtMost=1, Maximum=1.797693135e+308, Minimum=-1.797693135e+308, TreeAccess=False)  # disabled
plotdepth_2 = GetNumber(far, AtLeast=1, AtMost=1, Maximum=1.797693135e+308, Minimum=-1.797693135e+308, TreeAccess=False)  # disabled
far_2 = GetNumber(far, AtLeast=1, AtMost=1, Maximum=1.797693135e+308, Minimum=-1.797693135e+308, TreeAccess=False)  # disabled
setbackrear_2 = GetNumber(setbackrear, AtLeast=1, AtMost=1, Maximum=1.797693135e+308, Minimum=-1.797693135e+308, TreeAccess=False)  # disabled
setbackside_2 = GetNumber(setbackside, AtLeast=1, AtMost=1, Maximum=1.797693135e+308, Minimum=-1.797693135e+308, TreeAccess=False)  # disabled

exportlocation = Text(deserialize_json.ExportLocation)
roomname = Text(deserialize_json.RoomNames)
roomtopology = Text(deserialize_json.RoomTopology)

# ---- group: RoomArea
roomtopology_2 = Text(deserialize_json.RoomAreas)

# ----
plotwidth_3 = Number(deserialize_json.PlotWidth)
plotdepth_3 = Number(deserialize_json.PlotDepth)
far_3 = Number(deserialize_json.FAR)
setbackfront_3 = Number(deserialize_json_2.Front)
setbackrear_3 = Number(deserialize_json_2.Rear)
setbackside_3 = Number(deserialize_json_2.Side)
construct_domain = ConstructDomain(DomainStart=expr("x/-2", plotwidth_3), DomainEnd=expr("x/2", plotwidth_3))
construct_domain_2 = ConstructDomain(DomainStart=expr("x/-2", plotdepth_3), DomainEnd=expr("x/2", plotdepth_3))
unit_y = UnitY(Factor=setbackfront_3)
unit_y_2 = UnitY(Factor=expr("X*-1", setbackrear_3))
unit_x = UnitX(Factor=setbackside_3)
unit_x_2 = UnitX(Factor=expr("X*-1", setbackside_3))
rectangle = Rectangle(Plane=PlaneXY(0, 0, 0), XSize=construct_domain, YSize=construct_domain_2, Radius=0)  # -> Rectangle, Length
propline = Curve(rectangle.Rectangle)
area = Area(Geometry=propline)  # -> Area, Centroid

# ---- group: PlotArea
number = Number(area.Area)

# ----
multiplication = Multiplication(A=number, B=far_3)
bldgfootprintmaxarea = Number(multiplication)

# ----
# BldgSetback
control_points = ControlPoints(Curve=propline)  # -> Points, Weights, Knots
removeduplicatepts = RemoveDuplicatePts(Points=control_points.Points, Tolerance=0.01)
deconstruct = Deconstruct(Point=area.Centroid)  # -> XComponent, YComponent, ZComponent
deconstruct_2 = Deconstruct(Point=removeduplicatepts)  # -> XComponent, YComponent, ZComponent
larger_than = LargerThan(FirstNumber=deconstruct_2.XComponent, SecondNumber=deconstruct.XComponent)  # -> LargerThan, OrEqualTo
larger_than_2 = LargerThan(FirstNumber=deconstruct_2.YComponent, SecondNumber=deconstruct.YComponent)  # -> LargerThan, OrEqualTo
dispatch = Dispatch(List=removeduplicatepts, DispatchPattern=larger_than.LargerThan)  # -> ListA, ListB
move = Move(Geometry=dispatch.ListB, Motion=unit_x)  # -> Geometry, Transform
move_2 = Move(Geometry=dispatch.ListA, Motion=unit_x_2)  # -> Geometry, Transform
weave = Weave(Pattern=larger_than.LargerThan, Stream0=move_2.Geometry, Stream1=move.Geometry, NullGaps=False)
dispatch_2 = Dispatch(List=weave, DispatchPattern=larger_than_2.LargerThan)  # -> ListA, ListB
move_3 = Move(Geometry=dispatch_2.ListA, Motion=unit_y_2)  # -> Geometry, Transform
move_4 = Move(Geometry=dispatch_2.ListB, Motion=unit_y)  # -> Geometry, Transform
weave_2 = Weave(Pattern=larger_than_2.LargerThan, Stream0=move_3.Geometry, Stream1=move_4.Geometry, NullGaps=False)
polyline = PolyLine(Vertices=weave_2, Closed=True)

# ---- group: BldgSetback
buildablearea = Curve(polyline)

# ----
area_2 = Area(Geometry=buildablearea)  # -> Area, Centroid
# BldgFootprint
bldgfootprintmaxarea_2 = Number(bldgfootprintmaxarea)
larger_than_3 = LargerThan(FirstNumber=bldgfootprintmaxarea_2, SecondNumber=area_2.Area)  # -> LargerThan, OrEqualTo
stream_filter = StreamFilter(Gate=larger_than_3.LargerThan, Stream0=bldgfootprintmaxarea_2, Stream1=area_2.Area)

division = Division(A=stream_filter, B=area_2.Area)
scale = Scale(Geometry=buildablearea, Center=area_2.Centroid, Factor=division)  # -> Geometry, Transform
graph = Graph(Nodes=roomname, Edges=roomtopology, Areas=roomtopology_2)
buildablearea_2 = Curve(scale.Geometry)
planmaker = PlanMaker(Graph=graph, Boundary=buildablearea_2)

# ---- group: Hatches
hatch = Hatch()

# ----
propline_2 = Curve(propline)
buildablearea_3 = Curve(buildablearea)

# ---- group: BldgFootprint
buildablearea_4 = Curve(buildablearea_2)

# ---- group: Dimensions
linear_dimension = LinearDimension()

# ----
bounding_box = BoundingBox(Content=planmaker, Plane=PlaneXY(0, 0, 0), UnionBox=True)  # -> Box, Box_2

# ---- group: RH_OUT:Curve
buildablearea_5 = Curve(planmaker)

# ----
colour_swatch = ColourSwatch(SwatchColor=RGB(234, 0, 255))  # disabled
colour_swatch_2 = ColourSwatch(SwatchColor=RGB(0, 255, 21))  # disabled
colour_swatch_3 = ColourSwatch(SwatchColor=RGB(64, 0, 255))  # disabled
colour_swatch_4 = ColourSwatch(SwatchColor=RGB(255, 0, 0))  # disabled
colour_swatch_5 = ColourSwatch(SwatchColor=RGB(0, 0, 0))  # disabled
panel_2 = Panel("Rooms")  # disabled
panel_3 = Panel("Dimensions")  # disabled
panel_4 = Panel("Annotations")  # disabled
panel_5 = Panel("BldgFootprint")  # disabled
panel_6 = Panel("Hatch")  # disabled
panel_7 = Panel("PropLine")  # disabled
panel_8 = Panel("BldgSetback")  # disabled
area_3 = Area(Geometry=bounding_box.Box)  # -> Area, Centroid
area_4 = Area(Geometry=buildablearea_2)  # -> Area, Centroid
colour = Colour()  # disabled
entwine = Entwine(
    Branch00=colour_swatch,
    Branch01=colour_swatch_2,
    Branch02=colour_swatch_3,
    Branch03=colour_swatch_4,
    Branch04=colour_swatch_5,
    Branch05=colour_swatch_5,
    Branch06=colour_swatch_5,
    FlattenInputs=True)  # disabled
entwine_2 = Entwine(
    Branch00=colour_swatch,
    Branch01=colour_swatch_2,
    Branch02=colour_swatch_3,
    Branch03=colour_swatch_4,
    Branch04=colour_swatch_5,
    Branch05=colour,
    Branch06=colour_swatch_5,
    FlattenInputs=True)  # disabled
vector_2pt = Vector2Pt(PointA=area_3.Centroid, PointB=area_4.Centroid, Unitize=False)  # -> Vector, Length
entwine_3 = Entwine(
    Branch00=panel_7,
    Branch01=panel_8,
    Branch02=panel_5,
    Branch03=panel_2,
    Branch04=panel_4,
    Branch05=panel_6,
    Branch06=panel_3,
    FlattenInputs=True)  # disabled
move_5 = Move(Geometry=planmaker, Motion=vector_2pt.Vector)  # -> Geometry, Transform
rooms = Curve(move_5.Geometry)
create_modify_layers = CreateModifyLayers(LayerName=entwine_3, LayerColor=entwine, DeleteLayer=False, enableFullPath=False)  # -> LayerNames, LayerFullPath; disabled
area_5 = Area(Geometry=move_5.Geometry)  # -> Area, Centroid
annotation_text_settings = AnnotationTextSettings(TextHeight=Slider(0.3, range=0..20))  # -> TextSettings, Font, TextHeight, TextGap, MaskFrame, MaskColour, MaskMargins, ViewOriented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
integer = Integer(area_5.Area)
createattributes = CreateAttributes(PlotWeight=Slider(0.001, range=0..0.01), enableFullPath=False)  # -> flatten(ObjectAttributes)
concatenate = Concatenate(FragmentA=roomname, FragmentC=" ", FragmentB=integer, FragmentD="SQM")
text_entity = TextEntity(Plane=area_5.Centroid, Text=concatenate, TextSettings=annotation_text_settings.TextSettings)  # -> TextEntity, Plane, Text

# ---- group: Annotations
text_entity_2 = TextEntity(flatten(text_entity.TextEntity))

# ----
# Export DWG
entwine_4 = Entwine(
    Branch00=propline_2,
    Branch01=buildablearea_3,
    Branch02=buildablearea_4,
    Branch03=rooms,
    Branch04=text_entity_2,
    Branch05=hatch,
    Branch06=linear_dimension,
    FlattenInputs=True)
list_length = ListLength(List=flatten(entwine_4))  # disabled
repeat_data = RepeatData(Data=flatten(colour_swatch_2), Length=list_length)  # disabled
filename = Panel("TestSVG.svg")

# ---- group: FileLocation
text = Text(exportlocation)

# ----
filename_2 = Panel("3dmFromCompute.3dm")
model_block_definition = ModelBlockDefinition(Objects=flatten(entwine_4), Name="ExportTest")  # -> BlockDefinition, Objects, Name
concatenate_2 = Concatenate(FragmentA=text, FragmentB=filename)
concatenate_3 = Concatenate(FragmentA=text, FragmentB=filename_2)
panel_9 = Panel(concatenate_2)
export_as = ExportAs(
    Geometry=flatten(entwine_4),
    ObjectAttributes=createattributes,
    FileLocation=concatenate_2,
    Overwrite=True,
    Export=Toggle(True),
    CompMode=False,
    CopyAttributes=False,
    LastSaveLocalization="neutral,N",
    TreatGhGeoAsRef=True)  # -> OK, ExportCommand
boolean_toggle = BooleanToggle(True)
export_model_block_definition = ExportModelBlockDefinition(
    BlockDefinition=model_block_definition.BlockDefinition,
    FilePath=concatenate_3,
    Overwrite=boolean_toggle,
    Export=boolean_toggle)  # -> BlockDefinition, FilePath, Exported
panel_10 = Panel(export_model_block_definition.FilePath)
